# Dynamo graph Example CompoundStructure.dyn (Dynamo 1.2.1.3083)

wall_types = WallTypes("Generic - 8\"")
fromWall = Synthetic.Revit.CompoundStructure.FromWall(wall_types)
watch = Watch(fromWall)
getAllOpen = Synthetic.Revit.Document.GetAllOpen()
code_block = CodeBlock(doc=getAllOpen) { doc[0]; }
element_types = ElementTypes("WallType")
all_elements_of_type_in_document = Custom[All Elements of Type in Document](document=code_block, element_type=element_types)  # All elements of given type in specified document. This works for unopened files and for linked documents.
watch_2 = Watch(all_elements_of_type_in_document)
code_block_2 = CodeBlock(wt=all_elements_of_type_in_document) { wt[0][3]; }
watch_3 = Watch(code_block_2)
toWall = Synthetic.Revit.CompoundStructure.ToWall(code_block_2, fromWall)  # unwired: arg2
fromWall_2 = Synthetic.Revit.CompoundStructure.FromWall(toWall)
watch_4 = Watch(fromWall_2)
